# Grasshopper definition TerminalAutomation_Updated_WebApp.ghx (Grasshopper 1.0.8)
# plug-ins: Pufferfish, ShapeDiverForGrasshopper, eleFront, Wombat, AirportPlanning

level_of_service = ValueList({"A": 1, "B": 2, "C": 3, "D": 4, "E": 5, "F": 6}, selected="C")
wait_ciculatearea_m2 = Panel("""2.7
2.3
1.9
1.5
1.0
1.0""")
check_in_area_m2 = Panel("""1.6
1.4
1.2
1.0
0.8
0.5""")
panel = Panel("""A
B
C
D
E
F""")
max_wait_min = Panel("20")

# ---- group: Planning Inputs
avg_processing_min = Panel("2.5")
p_departing = Slider(80, range=20..80)
p_staffed_desk = Slider(80, range=20..80)
p_using_checkin = Slider(70, range=20..80)

# ----
check_in_counters = Slider(124, range=60..150)

# ----
# Planning Inputs
annual_pax_million = Slider(30, range=1..50)

# ---- group: IATA Inputs
level_of_service_2 = GetInteger(
    level_of_service,
    {"A": 1, "B": 2, "C": 3, "D": 4, "E": 5, "F": 6}, selected=[],
    AtLeast=1,
    AtMost=6,
    Maximum=2147483647,
    Minimum=-2147483648,
    TreeAccess=False)
avg_process_time_min_for_check_in = GetNumber(avg_processing_min, AtLeast=1, AtMost=1, Maximum=1.797693135e+308, Minimum=-1.797693135e+308, TreeAccess=False)
avg_process_time_min_for_check_in_2 = GetNumber(max_wait_min, AtLeast=1, AtMost=1, Maximum=1.797693135e+308, Minimum=-1.797693135e+308, TreeAccess=False)

# ---- group: Planning Inputs
passenger_departing = GetInteger(p_departing, AtLeast=20, AtMost=80, Maximum=2147483647, Minimum=-2147483648, TreeAccess=False)
staffed_desk = GetInteger(p_staffed_desk, AtLeast=20, AtMost=80, Maximum=2147483647, Minimum=-2147483648, TreeAccess=False)
passengers_using_check_in = GetInteger(p_using_checkin, AtLeast=20, AtMost=80, Maximum=2147483647, Minimum=-2147483648, TreeAccess=False)
annual_pax_million_2 = GetInteger(annual_pax_million, AtLeast=1, AtMost=50, Maximum=2147483647, Minimum=-2147483648, TreeAccess=False)

# ----
subtraction = Subtraction(A=level_of_service_2, B="1")
item = ListItem(List=panel, Index=subtraction, Wrap=True)
item_2 = ListItem(List=check_in_area_m2, Index=subtraction, Wrap=True)
item_3 = ListItem(List=wait_ciculatearea_m2, Index=subtraction, Wrap=True)

# ---- group: Spatial Inputs
list = ValueList({"Config A:Perpendicular to Movement": 0, "Config B:Parallel to Movement": 1}, selected="Config B:Parallel to Movement")
config_b_max_counters_in_line = Panel("15")
config_a_max_counters_in_line = Panel("35")

boundary_dimensions_x = Slider(180, range=50..300)
boundary_dimensionsy = Slider(44, range=10..100)
total_check_in_counters = GetInteger(check_in_counters, AtLeast=60, AtMost=150, Maximum=2147483647, Minimum=-2147483648, TreeAccess=False)

# ----
no_of_entry_gates = Slider(4, range=2..30)
pt = Point(Point(0, 0, 0))
xy = XYPlane(Origin=pt)

# ---- group: Spatial Inputs
boundary_dimensions_x_2 = GetInteger(boundary_dimensions_x, AtLeast=50, AtMost=300, Maximum=2147483647, Minimum=-2147483648, TreeAccess=False)
orientation_of_check_in_counters = GetInteger(
    list,
    {"Config A:Perpendicular to Movement": 0, "Config B:Parallel to Movement": 1}, selected=[],
    AtLeast=1,
    AtMost=1,
    Maximum=2147483647,
    Minimum=-2147483648,
    TreeAccess=False)
boundary_dimensions_y = GetInteger(boundary_dimensionsy, AtLeast=10, AtMost=100, Maximum=2147483647, Minimum=-2147483648, TreeAccess=False)
max_counters_in_a_row = GetInteger(config_a_max_counters_in_line, AtLeast=1, AtMost=1, Maximum=2147483647, Minimum=-2147483648, TreeAccess=False)
max_counters_in_a_columns = GetInteger(config_b_max_counters_in_line, AtLeast=1, AtMost=1, Maximum=2147483647, Minimum=-2147483648, TreeAccess=False)
no_of_entry_gates_2 = GetInteger(no_of_entry_gates, AtLeast=10, AtMost=100, Maximum=2147483647, Minimum=-2147483648, TreeAccess=False)

# ----
dom = ConstructDomain(DomainStart=0, DomainEnd=boundary_dimensions_x_2)
dom_2 = ConstructDomain(DomainStart=0, DomainEnd=boundary_dimensions_y)
rectangle = Rectangle(Plane=xy, XSize=dom, YSize=dom_2, Radius=0)  # -> Rectangle, Length
disc = Discontinuity(Curve=rectangle.Rectangle, Level=1)  # -> Points, Parameters
shatter = Shatter(Curve=rectangle.Rectangle, Parameters=disc.Parameters)
item_4 = ListItem(List=shatter, Index=0, Wrap=True)  # -> Item2, Item1, Item
range = Range(Domain=Domain(0, 1), Steps=expr("x*2", no_of_entry_gates_2))
offset = OffsetCurve(Curve=rectangle.Rectangle, Distance=expr("-x/2", "0.4"), Corners=1)
crv = Curve(item_4.Item2)
boundary = BoundarySurfaces(Edges=flatten([offset, rectangle.Rectangle]))
dispatch = Dispatch(List=range, DispatchPattern=[True, False])  # -> ListA, ListB
eval = EvaluateCurve(Curve=reparameterize(crv), Parameter=dispatch.ListB)  # -> Point, Tangent, Angle

filter = StreamFilter(Gate=orientation_of_check_in_counters, Stream0=max_counters_in_a_row, Stream1=max_counters_in_a_columns)
c_bake = ContextBake(BoundaryInput_155_171_32=boundary)
sort_pt = SortPoints(Points=eval.Point)  # -> Points, Indices

dom_3 = ConstructDomain(DomainStart=expr("-x", "0"), DomainEnd="6")
dom_4 = ConstructDomain(DomainStart=expr("-x", "6"), DomainEnd="6")
X = UnitX(Factor=1)
rectangle_2 = Rectangle(Plane=sort_pt.Points, XSize=dom_4, YSize=dom_3, Radius=0)  # -> Rectangle, Length
area = Area(Geometry=rectangle_2.Rectangle)  # -> Area, Centroid
srf = Surface(rectangle_2.Rectangle)
X_2 = UnitX(Factor=expr("-x", "6"))
move = Move(Geometry=area.Centroid, Motion=X_2)  # -> Geometry, Transform
line = LineSDL(Start=move.Geometry, Direction=X, Length=expr("x*2", "6"))

male_probability = Slider(0.7, range=0.1..1)
male_probability_2 = Slider(0.7, range=0.1..1)
index = ItemIndex(List=sort_pt.Points, Item=sort_pt.Points)
_2checkin_module = Curve(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)
list_2 = ValueList({"Domestic": 0, "International": 1}, selected="Domestic")
list_3 = ValueList({"Origin": 0, "Transfer": 1, "Destination": 2}, selected="Origin")
list_4 = ValueList({"Domestic": 0, "International": 1}, selected="International")
list_5 = ValueList({"Origin": 0, "Transfer": 1, "Destination": 2}, selected="Origin")
ap = ArrivalProfile(Peak="120", Sigma="1.5")
addition = Addition(A=index, B="1")
ap_2 = ArrivalProfile(Peak="200", Sigma="2.5")
concat = Concatenate(FragmentA="Gate ", FragmentB=addition)
random_seed = Panel("5")
wp = WalkingProfile(AverageSpeed="1.35", StandardDeviation="1")
multiplication = Multiplication(A="10", B="2")
brec = BoundingRectangle(Geometry=rectangle.Rectangle, Plane=PlaneXY(0, 0, 0), Axis=0, Slide=0, Union=True)  # -> Bounding, DimensionX, DimensionY
multiplication_2 = Multiplication(A="20", B="2")

expression = Expression(x=annual_pax_million_2, Expression="0.002*(1/x^(1/2))")
multiplication_3 = Multiplication(A=annual_pax_million_2, B="1000000")
multiplication_4 = Multiplication(A=expression, B=multiplication_3)
roundf = RoundToFactor(NumberX=multiplication_4, Factor="200", RoundType=0)  # -> Rounded, Difference, MultiplierR, MultiplierX
dhp = Integer(roundf.Rounded)

pd = PassengerDemand(DesignHourDemand=dhp, DeparturePercentage=Slider(70, range=0..100), DomesticPercentage=Slider(70, range=0..100))
pp = PassengerProfile(
    Name="Domestic Economy",
    Percentage=Slider(100, range=0..100),
    PassengerType=list_2,
    Journey=list_3,
    OnlineCheckInProbability=Slider(0.3, range=0.1..1),
    CheckedBagProbability=Slider(0.3, range=0.1..1),
    ServiceTimeMultiplier=1,
    MaleProbability=male_probability_2,
    ArrivalProfile=ap)
pp_2 = PassengerProfile(
    Name="International Leisure",
    Percentage=Slider(100, range=0..100),
    PassengerType=list_4,
    Journey=list_5,
    OnlineCheckInProbability=Slider(0.1, range=0.1..1),
    CheckedBagProbability=Slider(0.1, range=0.1..1),
    ServiceTimeMultiplier=1,
    MaleProbability=male_probability,
    ArrivalProfile=ap_2)
subtraction_2 = Subtraction(A=brec.DimensionX, B=multiplication_2)
subtraction_3 = Subtraction(A=brec.DimensionY, B=multiplication)
area_2 = Area(Geometry=brec.Bounding)  # -> Area, Centroid
pg = PassengerGenerator(
    PassengerDemand=pd,
    DomesticProfiles=pp,
    InternationalProfiles=pp_2,
    DepartureMinute="800",
    SimulationHorizon="300",
    WalkingProfile=wp,
    RandomSeed=random_seed)  # -> Passengers, PassengerGenerationResult, ArrivalSimulations
avg_processing_min_2 = Panel("2.5")
min_passenger = Panel("1.5")
target_wait_min = Panel("20")
staffing = Slider(100, range=0..100)
division = Division(A=subtraction_2, B=brec.DimensionX)
division_2 = Division(A=subtraction_3, B=brec.DimensionY)
optimize_counters = BooleanToggle(True)
Z = UnitZ(Factor="0.1")
integer_division = IntegerDivision(A=total_check_in_counters, B=filter)

brec_2 = BoundingRectangle(Geometry=_2checkin_module, Plane=PlaneXY(0, 0, 0), Axis=0, Slide=0, Union=True)  # -> Bounding, DimensionX, DimensionY
brec_3 = BoundingRectangle(Geometry=rectangle.Rectangle, Plane=PlaneXY(0, 0, 0), Axis=0, Slide=0, Union=True)  # -> Bounding, DimensionX, DimensionY
division_3 = Division(A=total_check_in_counters, B="2")
series = Series(Start=0, Step=brec_2.DimensionX, Count=expr("x/2", total_check_in_counters))
division_4 = Division(A=division_3, B=integer_division)
division_5 = Division(A=brec_3.DimensionX, B=integer_division)
round = Round(Number=division_4)  # -> Nearest, Floor, Ceiling
int = Integer(division_5)
c_script = CSharpScript(x=integer_division, y=round.Ceiling)  # -> out, PartitionSize, a; inputs x: Int32, y: Int32
# ---------- c_script: C# ----------
// Grasshopper Script Instance
#region Usings
using System;
using System.Linq;
using System.Collections;
using System.Collections.Generic;
using System.Drawing;

using Rhino;
using Rhino.Geometry;

using Grasshopper;
using Grasshopper.Kernel;
using Grasshopper.Kernel.Data;
using Grasshopper.Kernel.Types;
#endregion

public class Script_Instance : GH_ScriptInstance
{
    #region Notes
    /* 
      Members:
        RhinoDoc RhinoDocument
        GH_Document GrasshopperDocument
        IGH_Component Component
        int Iteration

      Methods (Virtual & overridable):
        Print(string text)
        Print(string format, params object[] args)
        Reflect(object obj)
        Reflect(object obj, string method_name)
    */
    #endregion

    private void RunScript(int x, int y, ref object PartitionSize, ref object a)
    {   
        int index;
        List<int> ListSize=new List<int>();
        if(x%2==0)
        {
            index=x/2;
        }
        else
         {index=(x+1)/2;
         }
         for(int i=0;i<x;i++)
         {
            if((x%2)!=0)
            {
            if(i==(index-1))
            ListSize.Add(y-(y%x));
            else
            ListSize.Add(y);
            }
            else
            {if(i==index-1)
            ListSize.Add(y-(y%x));
            else if(i==index)
            ListSize.Add(y-(y%x));
            else
            ListSize.Add(y);
            }
         }
        PartitionSize=ListSize;
    }
}
# ---------- end c_script ----------
range_2 = Range(Domain=Domain(0, 1), Steps=expr("x-1", integer_division))  # -> expr("x", Range)
series_2 = Series(Start=0, Step=int, Count=integer_division)

disc_2 = Discontinuity(Curve=brec_3.Bounding, Level=1)  # -> Points, Parameters
shatter_2 = Shatter(Curve=brec_3.Bounding, Parameters=disc_2.Parameters)
item_5 = ListItem(List=shatter_2, Index=0, Wrap=True)  # -> Item1, Item, Item1_2, Item2
crv_2 = Curve(item_5.Item)

scale_nu = ScaleNU(Geometry=brec.Bounding, Plane=area_2.Centroid, ScaleX=division, ScaleY=division_2, ScaleZ=1)  # -> Geometry, Transform
sp = ServiceProfile(MeanServiceTime=avg_processing_min_2, StandardDeviation=min_passenger)
dim = Dimensions(Surface=scale_nu.Geometry)  # -> UDimension, VDimension
explode = Explode(Curve=scale_nu.Geometry, Recursive=True)  # -> Segments, Vertices
drec = DeconstructRectangle(Rectangle=scale_nu.Geometry)  # -> BasePlane, XInterval, YInterval
pdt = PassengerDetails(Passengers=pg.Passengers)  # -> PassengerID, ArrivalTime, ServiceTime, StartService, EndService, WaitingTime, AssignedCounter, WalkingSpeed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
avg_processing_min_3 = Panel("1.5")
min_passenger_2 = Panel("0.5")
division_6 = Division(A=brec_2.DimensionX, B="2")
chk = CheckIn(
    Passengers=pg.Passengers,
    ServiceProfile=sp,
    CheckInCounters="8",
    OptimizeCounters=optimize_counters,
    TargetWait=target_wait_min,
    StaffingPercentage=staffing,
    RandomSeed=random_seed)  # -> Passengers, CheckInPassengers, QueueResults, CountersUsed, PeakQueueLength, AverageWait, MaximumWait, _95thPercentileWait, CounterUtilization

list_6 = ValueList({"Island", "Linear", "Flow-Through"}, selected="Flow-Through")
list_7 = ValueList({"CheckIn": 0, "BagDrop": 1, "Security": 2, "Immigration": 3}, selected="CheckIn")
division_7 = Division(A=brec_2.DimensionX, B="2")
tpl = FacilityTemplate(FacilityType=list_7, TopologyOverride=list_6)  # -> Template, AvailableTopologies
std = FacilityStandards(
    FacilityType=list_7,
    QueueAreaPax=Slider(1.3, range=1.3..1.8),
    ProcessorWidth=division_7,
    ProcessorDepth=brec_2.DimensionY,
    ProcessorPitch=division_7,
    Circulation=25,
    Support=10)
size = FacilitySizer(OperationalResults=chk.QueueResults, Passengers=chk.Passengers, Standards=std, Template=tpl.Template)  # -> SizingResult, TotalArea, QueueArea, ProcessingArea, CirculationArea, Topology, Advice, MalePassengers, FemalePassengers
panel_2 = Panel(size.QueueArea)

c_bake_2 = ContextBake(Gates_155_171_32=srf)
c_bake_3 = ContextBake(Gates_46_61_122=srf)
division_8 = Division(A=dim.VDimension, B=division_6)
panel_3 = Panel(pdt.ArrivalTime)
sp_2 = ServiceProfile(MeanServiceTime=avg_processing_min_3, StandardDeviation=min_passenger_2)
round_2 = Round(Number=division_8)  # -> Nearest, Floor, Ceiling
item_6 = ListItem(List=explode.Segments, Index=0, Wrap=True)  # -> Item, Item1, Item2
division_9 = Division(A=brec_2.DimensionX, B="2")

divide = DivideCurve(Curve=crv_2, Count=integer_division, Kinks=False)  # -> Points, Tangents, Parameters
item_7 = ListItem(List=divide.Points, Index=0, Wrap=True)
cull_ends = CullEnds(List=divide.Points)  # -> List, Culled
cp = ClosestPoint(Point=eval.Point, Cloud=cull_ends.List)  # -> ClosestPoint, CPIndex, Distance
ln = Line(StartPoint=eval.Point, EndPoint=cp.ClosestPoint)

staffing_2 = Slider(100, range=0..100)
optimize_counters_2 = BooleanToggle(True)
min = Minimum(A=round_2.Nearest, B=filter)
target_wait_min_2 = Panel("10")
multiplication_5 = Multiplication(A=min, B="2")
bd = BagDrop(
    Passengers=chk.Passengers,
    ServiceProfile=sp_2,
    BagDropCounters=8,
    OptimizeCounters=optimize_counters_2,
    TargetWait=target_wait_min_2,
    StaffingPercentage=staffing_2,
    RandomSeed=random_seed)  # -> Passengers, QueueResults, PhysicalCounters

list_8 = ValueList({"CheckIn": 0, "BagDrop": 1, "Security": 2, "Immigration": 3, "Verification": 4}, selected="BagDrop")
list_9 = ValueList({"Island", "Linear", "Retrofit"}, selected="Linear")
division_10 = Division(A=brec_2.DimensionX, B="2")
tpl_2 = FacilityTemplate(FacilityType=list_8, TopologyOverride=list_9)  # -> Template, AvailableTopologies
std_2 = FacilityStandards(
    FacilityType=list_8,
    QueueAreaPax=Slider(1.3, range=1.3..1.8),
    ProcessorWidth=division_10,
    ProcessorDepth=brec_2.DimensionY,
    ProcessorPitch=division_10,
    Circulation=25,
    Support=10)
size_2 = FacilitySizer(OperationalResults=bd.QueueResults, Passengers=bd.Passengers, Standards=std_2, Template=tpl_2.Template)  # -> SizingResult, TotalArea, QueueArea, ProcessingArea, CirculationArea, Topology, Advice, MalePassengers, FemalePassengers
panel_4 = Panel(size_2.TotalArea)

division_11 = Division(A=total_check_in_counters, B=multiplication_5)
from_facility = ValueList({"CheckIn", "BagDrop", "Immigration", "Security"}, selected="CheckIn")
from_facility_2 = ValueList({"CheckIn", "BagDrop", "Immigration", "Security"}, selected="BagDrop")
round_3 = Round(Number=division_11)  # -> Nearest, Floor, Ceiling
eligible = Slider(100, range=0..100)
wlk = Walking(Passengers=bd.Passengers, Distance="50", WalkingSpeed=wp, FromFacility=from_facility, ToFacility=from_facility_2)
division_12 = Division(A=brec_2.DimensionX, B="2")
divide_2 = DivideCurve(Curve=item_6.Item2, Count=expr("x-1", round_3.Nearest), Kinks=False)  # -> reverse(Points), Tangents, Parameters
divide_3 = DivideCurve(Curve=item_6.Item, Count=expr("x-1", round_3.Nearest), Kinks=False)  # -> Points, Tangents, Parameters
Y = UnitY(Factor=1)
multiplication_6 = Multiplication(A=min, B=division_12)
ver = PassengerVerification(Passengers=wlk, EligiblePercentage=eligible, ThroughputPerGate=300, DesignUtilization=0.85)  # -> Passengers, VerificationResults, RequiredGates, EligiblePassengers
line_2 = LineSDL(Start=divide_2.Points, Direction=expr("-x", Y), Length=multiplication_6)
from_facility_3 = ValueList({"CheckIn", "BagDrop", "Immigration", "Security"}, selected="BagDrop")
from_facility_4 = ValueList({"CheckIn", "BagDrop", "Immigration", "Security"}, selected="Immigration")
min_passenger_3 = Panel("0.2")
avg_processing_min_4 = Panel("0.4")

# ---- group: Passenger Verification
list_10 = ValueList({"CheckIn": 0, "BagDrop": 1, "Security": 2, "Immigration": 3, "Verification": 4}, selected="Verification")
list_11 = ValueList({"Island", "Linear", "Flow-Through"}, selected="Flow-Through")
division_13 = Division(A=brec_2.DimensionX, B="2")
tpl_3 = FacilityTemplate(FacilityType=list_10)  # -> Template, AvailableTopologies
std_3 = FacilityStandards(
    FacilityType=list_10,
    QueueAreaPax=Slider(1.3, range=1.3..1.8),
    ProcessorWidth=division_13,
    ProcessorDepth=brec_2.DimensionY,
    ProcessorPitch=division_13,
    Circulation=25,
    Support=10)
panel_5 = Panel(tpl_3.AvailableTopologies)
size_3 = FacilitySizer(OperationalResults=ver.VerificationResults, Passengers=ver.Passengers, Standards=std_3, Template=tpl_3.Template)  # -> SizingResult, TotalArea, QueueArea, ProcessingArea, CirculationArea, Topology, Advice, MalePassengers, FemalePassengers
panel_6 = Panel(size_3.TotalArea)

# ----
target_wait_min_3 = Panel("10")
wlk_2 = Walking(Passengers=ver.Passengers, Distance="50", WalkingSpeed=wp, FromFacility=from_facility_3, ToFacility=from_facility_4)
sp_3 = ServiceProfile(MeanServiceTime=avg_processing_min_4, StandardDeviation=min_passenger_3)
shift = ShiftList(List=divide_3.Parameters, Shift=1, Wrap=False)
imm = Immigration(
    Passengers=wlk_2,
    ServiceProfile=sp_3,
    ImmigrationBooths=8,
    OptimizeBooths=Toggle(True),
    TargetWait=target_wait_min_3,
    StaffingPercentage=Slider(100, range=0..100),
    RandomSeed=random_seed)  # -> Passengers, QueueResults, PhysicalBooths
pdt_2 = PassengerDetails(Passengers=imm.Passengers)  # -> PassengerID, ArrivalTime, ServiceTime, StartService, EndService, WaitingTime, AssignedCounter, WalkingSpeed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
offset_2 = OffsetCurve(Curve=line_2, Distance=expr("x/2", "3"), Corners=1)  # disabled
offset_3 = OffsetCurve(Curve=line_2, Distance=expr("-x/2", "3"), Corners=1)  # disabled
emigration_counter = Mesh([<mesh referenced from the Rhino model> x2])
avg_processing_min_5 = Panel("0.25")
min_passenger_4 = Panel("0.1")
merge = Merge(Data1=offset_3, Data2=offset_2)  # -> simplify(Result); disabled
flip = FlipCurve(Curve=offset_2)  # -> Curve, Flag; disabled
flip_2 = FlipCurve(Curve=offset_3)  # -> Curve, Flag; disabled
target_wait_min_4 = Panel("10")
panel_7 = Panel(pdt_2.ArrivalTime)
brec_4 = BoundingRectangle(Geometry=emigration_counter, Plane=PlaneXY(0, 0, 0), Axis=0, Slide=0, Union=True)  # -> Bounding, DimensionX, DimensionY
mirror = Mirror(Geometry=emigration_counter, Plane=PlaneYZ(0, 0, 0))  # -> Geometry, Transform
sp_4 = ServiceProfile(MeanServiceTime=avg_processing_min_5, StandardDeviation=min_passenger_4)
divlength = DivideLength(Curve=flip_2.Curve, Length=expr("x/2", brec_2.DimensionX))  # -> Points, Tangents, Parameters; disabled
divlength_2 = DivideLength(Curve=flip.Curve, Length=expr("x/2", brec_2.DimensionX))  # -> Points, Tangents, Parameters; disabled
brec_5 = BoundingRectangle(Geometry=merge, Plane=PlaneXY(0, 0, 0), Axis=0, Slide=0, Union=True)  # -> Bounding, DimensionX, DimensionY; disabled
multiplication_7 = Multiplication(A=brec_4.DimensionX, B="1.05")
geo = Geometry([emigration_counter, mirror.Geometry])
cull_i = CullIndex(List=divlength_2.Points, Indices=0, Wrap=True)  # disabled
cull_i_2 = CullIndex(List=divlength.Points, Indices=0, Wrap=True)  # disabled
panel_8 = Panel("1")  # disabled
sec = Security(
    Passengers=imm.Passengers,
    ServiceProfile=sp_4,
    SecurityLanes=8,
    OptimizeLanes=Toggle(True),
    TargetWait=target_wait_min_4,
    StaffingPercentage=Slider(80, range=0..100),
    RandomSeed=random_seed)  # -> Passengers, QueueResults, PhysicalLanes
pflip = FlipPlane(Plane=cull_i_2, ReverseX=False, ReverseY=True, SwapAxes=True)  # disabled
pflip_2 = FlipPlane(Plane=cull_i, ReverseX=True, ReverseY=True, SwapAxes=True)  # disabled
offset_4 = OffsetCurve(Curve=brec_5.Bounding, Distance=expr("-x/2", panel_8), Corners=1)  # disabled

list_12 = ValueList({"CheckIn": 0, "BagDrop": 1, "Security": 2, "Immigration": 3, "Verification": 4}, selected="Immigration")
list_13 = ValueList({"Linear": "Linear ", "Staggered", "E-Gate Bank"}, selected="E-Gate Bank")
tpl_4 = FacilityTemplate(FacilityType=list_12, TopologyOverride=list_13)  # -> Template, AvailableTopologies
std_4 = FacilityStandards(
    FacilityType=list_12,
    QueueAreaPax=Slider(1.2, range=0.2..1.2),
    ProcessorWidth=multiplication_7,
    ProcessorDepth=brec_4.DimensionY,
    ProcessorPitch=brec_4.DimensionX,
    Circulation=25,
    Support=10)
size_4 = FacilitySizer(OperationalResults=imm.QueueResults, Passengers=imm.Passengers, Standards=std_4, Template=tpl_4.Template)  # -> SizingResult, TotalArea, QueueArea, ProcessingArea, CirculationArea, Topology, Advice, MalePassengers, FemalePassengers

dispatch_2 = Dispatch(List=pflip, DispatchPattern=[True, False])  # -> ListA, ListB; disabled
dispatch_3 = Dispatch(List=pflip_2, DispatchPattern=[True, False])  # -> ListA, ListB; disabled
qs = QueueStatistics(QueueResults=sec.QueueResults)  # -> AverageWait, MaximumWait, _95thPercentileWait, PeakQueueLength, ResourceUtilization
fillet = Fillet(Curve=brec_5.Bounding, Radius=panel_8)  # disabled
fillet_2 = Fillet(Curve=offset_4, Radius=expr("x/2", panel_8))  # disabled
X_3 = UnitX(Factor=expr("x/2", brec_2.DimensionX))  # disabled
pdt_3 = PassengerDetails(Passengers=sec.Passengers)  # -> PassengerID, ArrivalTime, ServiceTime, StartService, EndService, WaitingTime, AssignedCounter, WalkingSpeed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
pdt_4 = PassengerDetails(Passengers=sec.Passengers)  # -> PassengerID, ArrivalTime, ServiceTime, StartService, EndService, WaitingTime, AssignedCounter, WalkingSpeed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
panel_9 = Panel("2")  # disabled
item_8 = ListItem(List=dispatch_3.ListA, Index=0, Wrap=True)  # -> Item1, Item; disabled
item_9 = ListItem(List=dispatch_2.ListA, Index=0, Wrap=True)  # -> Item1, Item; disabled
merge_2 = Merge(Data1=fillet, Data2=fillet_2)  # disabled
panel_10 = Panel(pdt_3.WaitingTime)
x_ray_machine = Mesh(<mesh referenced from the Rhino model>)
wtmd_machine = Mesh(<mesh referenced from the Rhino model>)
panel_11 = Panel(pdt_4.PassengerType)
pln = Plane(simplify([item_9.Item1, item_8.Item1]))  # disabled
pln_2 = Plane(simplify([dispatch_2.ListB, dispatch_3.ListB]))  # disabled
brec_6 = BoundingRectangle(Geometry=wtmd_machine, Plane=PlaneXY(0, 0, 0), Axis=0, Slide=0, Union=True)  # -> Bounding, DimensionX, DimensionY
brec_7 = BoundingRectangle(Geometry=x_ray_machine, Plane=PlaneXY(0, 0, 0), Axis=0, Slide=0, Union=True)  # -> Bounding, DimensionX, DimensionY
lng = ListLength(List=flatten(pln_2))  # -> expr("x*2", Length); disabled
lng_2 = ListLength(List=flatten(pln))  # disabled
multiplication_8 = Multiplication(A=multiplication_7, B="2")
ma = MassAddition(Input=[lng_2, lng])  # -> Result, PartialResults; disabled

panel_12 = Panel("2")  # disabled
panel_13 = Panel("2")  # disabled
addition_2 = Addition(A=brec_2.DimensionY, B=panel_12)  # disabled
addition_3 = Addition(A=brec_2.DimensionY, B=panel_13)  # disabled
offset_5 = OffsetCurve(Curve=offset_3, Distance=expr("-x", addition_3), Corners=1)  # disabled
offset_6 = OffsetCurve(Curve=offset_2, Distance=addition_2, Corners=1)  # disabled

multiplication_9 = Multiplication(A=panel_12, B="2")
X_4 = UnitX(Factor=multiplication_8)

list_14 = ValueList({"CheckIn": 0, "BagDrop": 1, "Security": 2, "Immigration": 3, "Verification": 4}, selected="Security")
list_15 = ValueList({"Centralized", "Decentralized"}, selected="Centralized")
division_14 = Division(A=brec_2.DimensionX, B="2")
tpl_5 = FacilityTemplate(FacilityType=list_14, TopologyOverride=list_15)  # -> Template, AvailableTopologies
std_5 = FacilityStandards(
    FacilityType=list_14,
    QueueAreaPax=Slider(1.2, range=0.2..1.2),
    ProcessorWidth=division_14,
    ProcessorDepth=brec_2.DimensionY,
    ProcessorPitch=division_14,
    Circulation=25,
    Support=10)
size_5 = FacilitySizer(OperationalResults=sec.QueueResults, Passengers=sec.Passengers, Standards=std_5, Template=tpl_5.Template)  # -> SizingResult, TotalArea, QueueArea, ProcessingArea, CirculationArea, Topology, Advice, MalePassengers, FemalePassengers
panel_14 = Panel(size_5.Advice)

insert = InsertBlock(BlockName="Block 02", Plane=pln)  # disabled
insert_2 = InsertBlock(BlockName="Block 01", Plane=pln_2)  # disabled

filter_2 = PassengerFilter(Passengers=imm.Passengers)  # -> Domestic, International, Male, Female, CheckedBags, CabinBagOnly
arrlinear = LinearArray(Geometry=geo, Direction=X_4, Count=expr("x/2", imm.PhysicalBooths))  # -> Geometry, Transform
panel_15 = Panel("10")  # disabled
merge_3 = Merge(Data1=insert, Data2=insert_2)  # disabled
min_walk = CSharpScript(x=cp.Distance, y="75")  # -> out, b, a; inputs x: list of Int32, y: Int32; disabled
# ---------- min_walk: C# ----------
// Grasshopper Script Instance
#region Usings
using System;
using System.Linq;
using System.Collections;
using System.Collections.Generic;
using System.Drawing;

using Rhino;
using Rhino.Geometry;

using Grasshopper;
using Grasshopper.Kernel;
using Grasshopper.Kernel.Data;
using Grasshopper.Kernel.Types;
#endregion

public class Script_Instance : GH_ScriptInstance
{
    #region Notes
    /* 
      Members:
        RhinoDoc RhinoDocument
        GH_Document GrasshopperDocument
        IGH_Component Component
        int Iteration

      Methods (Virtual & overridable):
        Print(string text)
        Print(string format, params object[] args)
        Reflect(object obj)
        Reflect(object obj, string method_name)
    */
    #endregion

    private void RunScript(List<int> x, int y, ref object b, ref object a)
    {
        foreach(int l in x)
        {
        if(l<75)
        {a="Walk Distance from Entry to E-Gates is comfortable";
          b=1;}
        else 
        {a=$"Walking Distance from Entry to E-Gate {l}m is not comfortable";
         b=2; }
        }
    }
}
# ---------- end min_walk ----------
eval_2 = EvaluateCurve(Curve=reparameterize(offset_5), Parameter=0)  # -> Point, Tangent, Angle; disabled
eval_3 = EvaluateCurve(Curve=reparameterize(offset_6), Parameter=1)  # -> Point, Tangent, Angle; disabled
len = Length(Curve=offset_6)  # disabled
len_2 = Length(Curve=offset_5)  # disabled
subtraction_4 = Subtraction(A=ma.Result, B=total_check_in_counters)  # disabled
item_10 = ListItem(List=min_walk.a, Index=0, Wrap=True)  # disabled
panel_16 = Panel("-90")  # disabled
panel_17 = Panel("90")  # disabled
min_counters = CSharpScript(x=subtraction_4)  # -> out, a; inputs x: Int32, y: Boolean; disabled
# ---------- min_counters: C# ----------
// Grasshopper Script Instance
#region Usings
using System;
using System.Linq;
using System.Collections;
using System.Collections.Generic;
using System.Drawing;

using Rhino;
using Rhino.Geometry;

using Grasshopper;
using Grasshopper.Kernel;
using Grasshopper.Kernel.Data;
using Grasshopper.Kernel.Types;
#endregion

public class Script_Instance : GH_ScriptInstance
{
    #region Notes
    /* 
      Members:
        RhinoDoc RhinoDocument
        GH_Document GrasshopperDocument
        IGH_Component Component
        int Iteration

      Methods (Virtual & overridable):
        Print(string text)
        Print(string format, params object[] args)
        Reflect(object obj)
        Reflect(object obj, string method_name)
    */
    #endregion

    private void RunScript(int x, bool y, ref object a)
    {
        if(x>0)
        a=$"You can reduce {x} counter";
        else if(x==0)
        a=$"The Configuration fits {x} counters";
        else 
        a=$"You need to add {Math.Abs(x)} counters";
    }
}
# ---------- end min_counters ----------
ma_2 = MassAddition(Input=flatten([len, len_2]))  # -> Result, PartialResults; disabled
prot = RotatePlane(Plane=eval_2.Point, Angle=degrees(panel_16))  # disabled
prot_2 = RotatePlane(Plane=eval_3.Point, Angle=degrees(panel_17))  # disabled
panel_18 = Panel("2")  # disabled
dom_5 = ConstructDomain(DomainStart=0, DomainEnd=len)  # disabled
panel_19 = Panel(min_counters.a)  # disabled
panel_20 = Panel("2")  # disabled
division_15 = Division(A="3", B=panel_18)  # disabled
panel_21 = Panel("1")  # disabled
subtraction_5 = Subtraction(A=round_3.Nearest, B=panel_21)  # disabled
panel_22 = Panel("2")  # disabled
filter_3 = PassengerFilter(Passengers=sec.Passengers)  # -> Domestic, International, Male, Female, CheckedBags, CabinBagOnly
md_slider = MDSlider(
    SliderMode=0,
    slider_value=Point(0.502658751, 1, 0.5),
    x_domain=Domain(0, 1),
    y_domain=Domain(0, 1),
    z_domain=Domain(0, 1))  # disabled
panel_23 = Panel("5")  # disabled
panel_24 = Panel("2")  # disabled
filter_4 = PassengerFilter(Passengers=filter_3.Domestic)  # -> Domestic, International, Male, Female, CheckedBags, CabinBagOnly
filter_5 = PassengerFilter(Passengers=filter_3.International)  # -> Domestic, International, Male, Female, CheckedBags, CabinBagOnly
panel_25 = Panel("2")  # disabled
panel_26 = Panel("2")  # disabled
panel_27 = Panel("5")  # disabled
division_16 = Division(A=brec_3.DimensionX, B=panel_26)  # disabled
panel_28 = Panel("6")  # disabled
panel_29 = Panel(division_16)  # disabled

md_slider_2 = MDSlider(
    SliderMode=0,
    slider_value=Point(0.5406689528, 0.826637082, 0.5),
    x_domain=Domain(0, 1),
    y_domain=Domain(0, 1),
    z_domain=Domain(0, 1))  # disabled
evalsrf = EvaluateSurface(Surface=reparameterize(brec_3.Bounding), Point=md_slider_2)  # -> Point, Normal, UDirection, VDirection, Frame; disabled
panel_30 = Panel("2")  # disabled
Y_2 = UnitY(Factor=panel_30)  # disabled
move_2 = Move(Geometry=evalsrf.Point, Motion=Y_2)  # -> Geometry, Transform; disabled
X_5 = UnitX(Factor=expr("-x", division_16))  # disabled
move_3 = Move(Geometry=move_2.Geometry, Motion=X_5)  # -> Geometry, Transform; disabled

panel_31 = Panel("100")  # disabled
division_17 = Division(A=panel_31, B=staffed_desk)  # disabled
xy_2 = XYPlane(Origin=Point(0, 0, 0))  # disabled
panel_32 = Panel(" is not sufficient(Check Width of Aisles).")  # disabled
panel_33 = Panel(" is not sufficient(Check Depth or Aisle Spacing).")  # disabled
panel_34 = Panel("90")  # disabled
prot_3 = RotatePlane(Plane=xy_2, Angle=degrees(panel_34))  # disabled
tag_orientation = StreamFilter(Gate=orientation_of_check_in_counters, Stream0=xy_2, Stream1=prot_3)  # disabled
furniture_blocks = StreamFilter(Gate=orientation_of_check_in_counters, Stream0=panel_32, Stream1=panel_33)  # disabled
furniture_blocks_2 = StreamFilter(Gate=orientation_of_check_in_counters, Stream0=move_3.Geometry, Stream1=move_3.Geometry)  # disabled
panel_35 = Panel("Designed Check In  Area of ")  # disabled
over_design = ColourSwatch(SwatchColor=RGBA(255, 23, 23, 100))  # disabled
panel_36 = Panel("3")  # disabled
panel_37 = Panel("sq.m")  # disabled
panel_38 = Panel("1")  # disabled
Y_3 = UnitY(Factor=panel_38)  # disabled
X_6 = UnitX(Factor=1)  # disabled
swatch = ColourSwatch(SwatchColor=RGB(0, 0, 0))  # disabled
panel_39 = Panel("E-Gates")  # disabled
panel_40 = Panel("100")  # disabled
division_18 = Division(A=panel_40, B=p_staffed_desk)  # disabled
concat_2 = Concatenate(FragmentA=panel_39)  # disabled
sub_optimum = ColourSwatch(SwatchColor=RGB(255, 200, 61))  # disabled
optimum = ColourSwatch(SwatchColor=RGB(43, 166, 53))  # disabled
over_design_2 = ColourSwatch(SwatchColor=RGB(255, 23, 23))  # disabled
panel_41 = Panel("95th Percentile Wait Time (min)")  # disabled
panel_42 = Panel("Average Wait Time (min)")  # disabled
panel_43 = Panel("Queue Depth (m)")  # disabled
panel_44 = Panel("BLEND")  # disabled
panel_45 = Panel("Queue Area (sq.m)")  # disabled
panel_46 = Panel("Configuration of ")  # disabled
panel_47 = Panel(" Counters is ")  # disabled
panel_48 = Panel("Peak Queue Length Combined")  # disabled
gltf2material = GlTF20Material(
    BaseColorFactor=optimum,
    MetallicFactor=0,
    RoughnessFactor=1,
    EmissiveFactor=RGB(0, 0, 0),
    AlphaMode=panel_44,
    AlphaCutoff=0.5,
    DoubleSided=False)  # disabled
gltf2material_2 = GlTF20Material(
    BaseColorFactor=over_design_2,
    MetallicFactor=0,
    RoughnessFactor=1,
    EmissiveFactor=RGB(0, 0, 0),
    AlphaMode=panel_44,
    AlphaCutoff=0.5,
    DoubleSided=False)  # disabled
gltf2material_3 = GlTF20Material(
    BaseColorFactor=sub_optimum,
    MetallicFactor=0,
    RoughnessFactor=1,
    EmissiveFactor=RGB(0, 0, 0),
    AlphaMode=panel_44,
    AlphaCutoff=0.5,
    DoubleSided=False)  # disabled
panel_49 = Panel(":")  # disabled
panel_50 = Panel("""A
B
C
D
E
F
G
H
I
J
K
L""")  # disabled
panel_51 = Panel("Zone ")  # disabled
panel_52 = Panel("Optimum")  # disabled
panel_53 = Panel("Over-Design")  # disabled
panel_54 = Panel("Sub-Optimum")  # disabled
panel_55 = Panel("1,0.5")  # disabled
panel_56 = Panel("0.15")  # disabled
panel_57 = Panel("10")  # disabled
panel_58 = Panel("1.5")  # disabled
textsrf = TextOnSurface(Text=concat, Font="Sans Bold:no Italic:no", Height=panel_58, Depth=0, BaseLine=line, BaseSurface=srf)  # -> flatten(Symbols)
move_4 = Move(Geometry=textsrf, Motion=Z)  # -> Geometry, Transform
preview = CustomPreview(Geometry=move_4.Geometry, Material=ColourSwatch(SwatchColor=RGB(255, 0, 0)))
Z_2 = UnitZ(Factor=0.1)  # disabled
filter_6 = StreamFilter(Gate=0, Stream0=panel_53, Stream1=panel_52, Stream2=panel_54)  # disabled
paramptinrec = ParameterPointInRectangle(Rectangle=rectangle.Rectangle, ParameterX=0.5, ParameterY=0.85)  # -> Point, Normal; disabled
filter_7 = StreamFilter(Gate=0, Stream0=over_design_2, Stream1=optimum, Stream2=sub_optimum)  # disabled
panel_59 = Panel("sq.m.This includes Queue Area, Circulation Area and Corridor Area")  # disabled
panel_60 = Panel("Total designed check in area is ")  # disabled
panel_61 = Panel("")  # disabled
panel_62 = Panel(" in the layout")  # disabled
pt_2 = Point(paramptinrec.Point)  # disabled
X_7 = UnitX(Factor=1)  # disabled
panel_63 = Panel("8")  # disabled
line_3 = LineSDL(Start=pt_2, Direction=expr("-x", X_7), Length=panel_63)  # disabled
line_4 = LineSDL(Start=pt_2, Direction=X_7, Length=panel_63)  # disabled
join = JoinCurves(Curves=[line_4, line_3], Preserve=False)  # disabled
flip_3 = FlipCurve(Curve=join)  # -> Curve, Flag; disabled
srf_2 = Surface(rectangle.Rectangle)  # disabled

concat_3 = Concatenate(FragmentA="Your desired LoS was ", FragmentB=item, FragmentC=",and you are successfully delivering it.")

subtraction_6 = Subtraction(A=100, B=passengers_using_check_in)
self_check_in = Panel(subtraction_6)
multiplication_10 = Multiplication(A=passenger_departing, B=dhp, C="0.01")
multiplication_11 = Multiplication(A=multiplication_10, B=passengers_using_check_in, C="0.01")
min_passenger_5 = Panel("1.5")

physical_counter_check_in = Integer(multiplication_11)
dist_arrival_perflight = CSharpScript(PaxCount=physical_counter_check_in, DepMinute="800", Horizon="300", Run=Toggle(True), Seed=Slider(60, range=0..100))  # -> out, ArrivalMinutes, Histogram, LambdaValues; inputs PaxCount: Int32, DepMinute: Int32, Horizon: Int32, Run: Boolean, Seed: Int32
# ---------- dist_arrival_perflight: C# ----------
// Grasshopper Script Instance
#region Usings
using System;
using System.Linq;
using System.Collections;
using System.Collections.Generic;
using System.Drawing;

using Rhino;
using Rhino.Geometry;

using Grasshopper;
using Grasshopper.Kernel;
using Grasshopper.Kernel.Data;
using Grasshopper.Kernel.Types;
#endregion

public class Script_Instance : GH_ScriptInstance
{
    #region Notes
    /* 
      Members:
        RhinoDoc RhinoDocument
        GH_Document GrasshopperDocument
        IGH_Component Component
        int Iteration

      Methods (Virtual & overridable):
        Print(string text)
        Print(string format, params object[] args)
        Reflect(object obj)
        Reflect(object obj, string method_name)
    */
    #endregion

    private void RunScript(
		int PaxCount,
		int DepMinute,
		int Horizon,
		bool Run,
		int Seed,
		ref object ArrivalMinutes,
		ref object Histogram,
		ref object LambdaValues)
{
    if (!Run)
        return;

    Random rnd = new Random(Seed);

    List<double> lambda = new List<double>();
    List<int> hist = new List<int>();
    List<int> arrivals = new List<int>();

    // ------------------------------------------------------------------
    // Define the arrival profile (Gaussian shape)
    // ------------------------------------------------------------------
    double peak = 90.0;   // Most passengers arrive 90 min before departure
    double sigma = 35.0;  // Spread of arrivals

    // Build unscaled profile
    double totalWeight = 0.0;

    for (int t = Horizon; t >= 1; t--)
    {
        double z = (t - peak) / sigma;
        double w = Math.Exp(-0.5 * z * z);
        lambda.Add(w);
        totalWeight += w;
    }

    // Scale profile so total expected passengers = PaxCount
    double scale = PaxCount / totalWeight;

    for (int i = 0; i < lambda.Count; i++)
        lambda[i] *= scale;

    // ------------------------------------------------------------------
    // Simulate arrivals minute by minute
    // ------------------------------------------------------------------
    int generated = 0;

    for (int i = 0; i < Horizon; i++)
    {
        double lam = lambda[i];
        int count = SamplePoisson(lam, rnd);

        // Ensure we do not exceed total passengers
        if (generated + count > PaxCount)
            count = PaxCount - generated;

        hist.Add(count);

        // Convert minute index to actual clock time
        int minutesBeforeDeparture = Horizon - i;
        int arrivalMinute = DepMinute - minutesBeforeDeparture;

        for (int k = 0; k < count; k++)
            arrivals.Add(arrivalMinute);

        generated += count;

        if (generated >= PaxCount)
        {
            // Fill remaining histogram entries with zeros
            for (int j = i + 1; j < Horizon; j++)
                hist.Add(0);
            break;
        }
    }

    ArrivalMinutes = arrivals.Select(a=> Horizon-(DepMinute-a));
    Histogram = hist;
    LambdaValues = lambda;
}

// ----------------------------------------------------------------------
// Poisson random sampler (Knuth algorithm)
// ----------------------------------------------------------------------
private int SamplePoisson(double lambda, Random rnd)
{
    if (lambda <= 0.0)
        return 0;

    double L = Math.Exp(-lambda);
    int k = 0;
    double p = 1.0;

    do
    {
        k++;
        p *= rnd.NextDouble();
    }
    while (p > L);

    return k - 1;
}
}
# ---------- end dist_arrival_perflight ----------

dist_arrival_perflight_2 = CSharpScript(
    arrivals=dist_arrival_perflight.ArrivalMinutes,
    Mean=avg_process_time_min_for_check_in,
    StandardDeviation=min_passenger_5)  # -> out, ServiceTimes; inputs arrivals: list of Int32, Mean: Double, StandardDeviation: Double
# ---------- dist_arrival_perflight_2: C# ----------
// Grasshopper Script Instance
#region Usings
using System;
using System.Linq;
using System.Collections;
using System.Collections.Generic;
using System.Drawing;

using Rhino;
using Rhino.Geometry;

using Grasshopper;
using Grasshopper.Kernel;
using Grasshopper.Kernel.Data;
using Grasshopper.Kernel.Types;
#endregion

public class Script_Instance : GH_ScriptInstance
{
    #region Notes
    /* 
      Members:
        RhinoDoc RhinoDocument
        GH_Document GrasshopperDocument
        IGH_Component Component
        int Iteration

      Methods (Virtual & overridable):
        Print(string text)
        Print(string format, params object[] args)
        Reflect(object obj)
        Reflect(object obj, string method_name)
    */
    #endregion

    private void RunScript(
		List<int> arrivals,
		double Mean,
		double StandardDeviation,
		ref object ServiceTimes)
    {
        List<double> serviceTimes = new List<double>();
        Random rnd=new Random();

    for (int i = 0; i < arrivals.Count; i++)
    {
        double s = SampleLognormal(Mean,StandardDeviation, rnd);
        serviceTimes.Add(s);
    }
    ServiceTimes=serviceTimes;
    }
    private double SampleLognormal(double mean,double std,Random rnd)
    {
        double m;
        double v;
        double s;
        v=std*std;
        s=Math.Sqrt(Math.Log(1+((std*std)/(mean*mean))));
        m=Math.Log(mean)-0.5*s*s;

        //Standard normal using Box -Muller
        double u1=rnd.NextDouble();
        double u2=rnd.NextDouble();
        double z=Math.Sqrt(-2.0*Math.Log(u1))*Math.Cos(2.0*Math.PI*u2);
        
        return Math.Round(Math.Exp(m+s*z),2);
    }

}
# ---------- end dist_arrival_perflight_2 ----------
c_script_2 = CSharpScript(
    arrivalTimes=dist_arrival_perflight.ArrivalMinutes,
    serviceTimes=dist_arrival_perflight_2.ServiceTimes,
    horizon="300",
    N=total_check_in_counters)  # -> out, PeakQueueLength, AverageWait, MaxWait, Wait95, CounterUtilization; inputs arrivalTimes: list of Double, serviceTimes: list of Double, horizon: Int32, N: Int32; disabled
# ---------- c_script_2: C# ----------
// Grasshopper Script Instance
#region Usings
using System;
using System.Linq;
using System.Collections;
using System.Collections.Generic;
using System.Drawing;

using Rhino;
using Rhino.Geometry;

using Grasshopper;
using Grasshopper.Kernel;
using Grasshopper.Kernel.Data;
using Grasshopper.Kernel.Types;
#endregion

public class Script_Instance : GH_ScriptInstance
{
    #region Notes
    /* 
      Members:
        RhinoDoc RhinoDocument
        GH_Document GrasshopperDocument
        IGH_Component Component
        int Iteration

      Methods (Virtual & overridable):
        Print(string text)
        Print(string format, params object[] args)
        Reflect(object obj)
        Reflect(object obj, string method_name)
    */
    #endregion

    public class Passenger
    {
        //Inputs
        public double ArrivalTime{get;set;}
        public double ServiceTime{get;set;}

        //Outputs from Queue Simulation
        public double StartServiceTime { get;set;}
        public double EndServiceTime {get;set;}
        public double WaitTime{get;set;}
        public int AssignedCounter{get;set;}
    }
    public class Counter
    {
        public int Id {get;set;}
        public double NextAvailableTime {get;set;}
    }
    //Factory style method to populate Passengers
    public List<Passenger> CreatePassenger(List<double> arrivalTimes,List<double> serviceTimes)
    {
        List<Passenger> passengers=new List<Passenger>();
        for(int i=0; i<arrivalTimes.Count; i++)
        {Passenger p=new Passenger();
         p.ArrivalTime=arrivalTimes[i];
         p.ServiceTime=serviceTimes[i];
         passengers.Add(p);
        }
        return passengers;
    }
    //Factory style method to Populate Counters
    public List<Counter> CreateCounters(int numberOfCounters)
    {
        List<Counter> counters=new List<Counter>();
        for(int i=0;i<numberOfCounters;i++)
        {
            Counter C=new Counter();
            C.Id=i;
            C.NextAvailableTime=0.0;
            counters.Add(C);
        }
        return counters;
    }
    private void RunQueue(List<Passenger> passengers,List<Counter> counters)
    {//Ensure All the passengers are processed in arrival order
      passengers.Sort((a,b)=> a.ArrivalTime.CompareTo(b.ArrivalTime));
      foreach(Passenger p in passengers)
        {
            //Find Earliest Available Counter
            Counter best=counters[0];
            for(int i=1;i<counters.Count;i++)
            {
                //Find earliest available Counter 
                if(counters[i].NextAvailableTime < best.NextAvailableTime)
                {
                    best=counters[i];
                }
            }
            p.StartServiceTime=Math.Max(p.ArrivalTime,best.NextAvailableTime);
            p.WaitTime=(p.StartServiceTime-p.ArrivalTime);
            p.EndServiceTime=p.StartServiceTime+p.ServiceTime;
            p.AssignedCounter=best.Id;
            best.NextAvailableTime=p.EndServiceTime;
        }

    }
    //Getting the relevant Metrics for the passengers and the Counters
    private void GetPassengerMetrics(List<Passenger>passengers,ref double AverageWait,ref double MaxWait,ref double Wait95)
    {
        List<double> sortedWaitTimes=passengers.Select(p=>p.WaitTime).OrderBy(w=>w).ToList();
        int index=(int)Math.Ceiling(0.95*sortedWaitTimes.Count)-1;

        AverageWait=passengers.Average(p=>p.WaitTime);
        MaxWait=passengers.Max(p=>p.WaitTime);
        Wait95=sortedWaitTimes[index];
    }
    //Getting Peak Queue Length to Compare with LoS Metric
   private int GetPeakQueueLength(List<Passenger> passengers)
    {
    // No passengers
    if (passengers == null || passengers.Count == 0)
        return 0;

    // Ensure chronological order
    passengers.Sort((a, b) =>
        a.ArrivalTime.CompareTo(b.ArrivalTime));

    int peakQueue = 0;

    // Check queue length at each passenger arrival time
    foreach (Passenger current in passengers)
    {
        int queueLength = 0;
        double t = current.ArrivalTime;

        // Count passengers who have arrived but have not yet started service
        foreach (Passenger p in passengers)
        {
            if (p.ArrivalTime <= t &&
                p.StartServiceTime > t)
            {
                queueLength++;
            }
        }

        if (queueLength > peakQueue)
            peakQueue = queueLength;
    }

    return peakQueue;
    }
    //
    private void GetCounterUtilization(List<Passenger> passengers,List<Counter> counters,ref List<double>utilization)
    {
        //No Counters
        if((counters==null)||counters.Count==0)
        return;

        //No Passengers
        if(passengers==null||passengers.Count==0)
        {
            for(int i=0;i<counters.Count;i++)
            {
                utilization.Add(0.0);
                return;
            }
        }
        double simulationDuration=passengers.Max(p=>p.EndServiceTime);
        if(simulationDuration <=0.0)
        {for(int i=0;i<counters.Count;i++)
            {
                utilization.Add(0.0);
                return;
            }

        }
        foreach(Counter C in counters)
        {
            double busyTime=0.0;
            foreach(Passenger p in passengers)
            {
                if(p.AssignedCounter==C.Id)
                {
                    busyTime+=p.ServiceTime;
                }
            }
            double u=busyTime/simulationDuration;
            utilization.Add(u);
        }

    }
    private void GetPassengerPerCounter()
    {
        
    }
    private void RunScript(
		List<double> arrivalTimes,
		List<double> serviceTimes,
		int horizon,
		int N,
		ref object PeakQueueLength,
		ref object AverageWait,
		ref object MaxWait,
		ref object Wait95,
		ref object CounterUtilization)
    {
        // Write your logic here
        List<Passenger> passengers=new List<Passenger>();
        List<Counter> counters=new List<Counter>();
        passengers=CreatePassenger(arrivalTimes,serviceTimes);
        counters=CreateCounters(N);
        RunQueue(passengers,counters);
        //Sanity Check
        double totalServiceDemand = passengers.Sum(p => p.ServiceTime);
        double totalCapacity =counters.Count * passengers.Max(p => p.ArrivalTime);
        Print($"Demand/Capacity = {Math.Round((totalServiceDemand / totalCapacity),2)}");

        List<double> utilization=new List<double>();
        GetCounterUtilization(passengers,counters,ref utilization);
         PeakQueueLength=GetPeakQueueLength(passengers);
         double avgWait=0;
         double maxWait=0;
         double wait95=0;
         GetPassengerMetrics(passengers,ref avgWait,ref maxWait,ref wait95);
         AverageWait=avgWait;
         MaxWait=maxWait;
         Wait95=wait95;
         CounterUtilization=utilization;
    }
}
# ---------- end c_script_2 ----------

# ---- group: Peak Queueing Area
area_for_ropes_corners = Panel("1.2")  # disabled
multiplication_12 = Multiplication(A=c_script_2.PeakQueueLength, B=item_2)  # disabled

# ----
c_script_3 = CSharpScript(y=c_script_2.Wait95)  # -> out, a; inputs y: Double; disabled
# ---------- c_script_3: C# ----------
// Grasshopper Script Instance
#region Usings
using System;
using System.Linq;
using System.Collections;
using System.Collections.Generic;
using System.Drawing;

using Rhino;
using Rhino.Geometry;

using Grasshopper;
using Grasshopper.Kernel;
using Grasshopper.Kernel.Data;
using Grasshopper.Kernel.Types;
#endregion

public class Script_Instance : GH_ScriptInstance
{
    #region Notes
    /* 
      Members:
        RhinoDoc RhinoDocument
        GH_Document GrasshopperDocument
        IGH_Component Component
        int Iteration

      Methods (Virtual & overridable):
        Print(string text)
        Print(string format, params object[] args)
        Reflect(object obj)
        Reflect(object obj, string method_name)
    */
    #endregion

    private void RunScript(double y, ref object a)
    {
        string b;
        // Write your logic here
       
         if(y<10)
         b="A";
         else if(y<12)
         b="B";
         else if(y<20)
         b="C";
         else if(y<25)
         b="D";
         else if(y<30)
         b="E";
         else
         b="F";
        
        a=b;
    }
}
# ---------- end c_script_3 ----------
expression_2 = Expression(x=item, y=c_script_3.a, Expression="If(x=y, true, false)")

concat_4 = Concatenate(FragmentA="Your desired LoS was ", FragmentB=item, FragmentC=",but you are delivering ", FragmentD=c_script_3.a)

filter_8 = StreamFilter(Gate=expression_2, Stream0=concat_4, Stream1=concat_3)
panel_64 = Panel(filter_8)
multiplication_13 = Multiplication(A=c_script_2.PeakQueueLength, B=item_3)  # disabled
multiplication_14 = Multiplication(A=division_18, B=c_script_2.Wait95)  # disabled
c_script_4 = CSharpScript(x=multiplication_14, y=avg_process_time_min_for_check_in_2)  # -> out, a; inputs x: Double, y: Double; disabled
# ---------- c_script_4: C# ----------
// Grasshopper Script Instance
#region Usings
using System;
using System.Linq;
using System.Collections;
using System.Collections.Generic;
using System.Drawing;

using Rhino;
using Rhino.Geometry;

using Grasshopper;
using Grasshopper.Kernel;
using Grasshopper.Kernel.Data;
using Grasshopper.Kernel.Types;
#endregion

public class Script_Instance : GH_ScriptInstance
{
    #region Notes
    /* 
      Members:
        RhinoDoc RhinoDocument
        GH_Document GrasshopperDocument
        IGH_Component Component
        int Iteration

      Methods (Virtual & overridable):
        Print(string text)
        Print(string format, params object[] args)
        Reflect(object obj)
        Reflect(object obj, string method_name)
    */
    #endregion

    private void RunScript(double x, double y, ref object a)
    {
    if (x < y/2)
         a= 1;
    else if (x < y) // here x is already >= 10
         a= 0;
    else
   a= 2;     // x >= 20
    }
    
}
# ---------- end c_script_4 ----------
int_2 = Integer(c_script_4.a)  # disabled
round_4 = Round(Number=c_script_2.Wait95)  # -> Nearest, Floor, Ceiling; disabled
round_5 = Round(Number=c_script_2.AverageWait)  # -> Nearest, Floor, Ceiling; disabled
filter_9 = StreamFilter(Gate=int_2, Stream0=panel_52, Stream1=panel_53, Stream2=panel_54)  # disabled
filter_10 = StreamFilter(Gate=int_2, Stream0=optimum, Stream1=over_design_2, Stream2=sub_optimum)  # disabled
_95_percentile_wait_time_min = Panel(round_4.Floor)  # disabled
_95_percentile_wait_time_min_2 = Panel(round_5.Floor)  # disabled
peak_queue_length = Panel(c_script_2.PeakQueueLength)  # disabled
demand_capacity = Panel(c_script_2.out)  # disabled
filter_11 = StreamFilter(Gate=int_2, Stream0=gltf2material, Stream1=gltf2material_2, Stream2=gltf2material_3)  # disabled
c_print = ContextPrint(CheckInAreaColor=filter_10)  # disabled
concat_5 = Concatenate(FragmentA=panel_48, FragmentD=panel_49, FragmentB=peak_queue_length)  # disabled
concat_6 = Concatenate(FragmentA=panel_41, FragmentD=panel_49, FragmentB=_95_percentile_wait_time_min)  # disabled
concat_7 = Concatenate(FragmentA=panel_42, FragmentD=panel_49, FragmentB=_95_percentile_wait_time_min_2)  # disabled
concat_8 = Concatenate(FragmentC=panel_46, FragmentA=total_check_in_counters, FragmentD=panel_47, FragmentB=filter_9)  # disabled
concat_9 = Concatenate(FragmentB=filter_8)  # disabled
textsrf_2 = TextOnSurface(Text=filter_9, Font="Sans Bold:no Italic:no", Height=3, Depth=0.4, BaseLine=flip_3.Curve, BaseSurface=srf_2)  # disabled

# ---- group: ARDM text
c_bake_4 = ContextBake(Counters_46_61_122=textsrf_2)  # disabled

# ----
partition = PartitionList(List=series, Size=c_script.PartitionSize)  # -> simplify(Chunks)
lng_3 = ListLength(List=partition)
multiplication_15 = Multiplication(A=lng_3, B=brec_2.DimensionX)
bnd = Bounds(Numbers=partition)
dedomain = DeconstructDomain(Domain=bnd)  # -> Start, End
subtraction_7 = Subtraction(A=simplify(graft(series_2)), B=dedomain.Start)
panel_65 = Panel("0.5")  # disabled
panel_66 = Panel("2")  # disabled
panel_67 = Panel("0")  # disabled

subtraction_8 = Subtraction(A=int, B=multiplication_15)
addition_4 = Addition(A=partition, B=subtraction_7)

cull_i_3 = CullIndex(List=flatten(subtraction_8), Indices=integer_division, Wrap=True)

lng_4 = ListLength(List=cull_i_3)  # -> expr("x-1", Length)
max = Maximum(A=lng_4, B="1")
ma_3 = MassAddition(Input=cull_i_3)  # -> Result, PartialResults

division_19 = Division(A=ma_3.Result, B=max)

panel_68 = Panel(ma_3.Result)
min_cross_circulation_spacing = Integer(division_19)  # disabled
min_cross_circulation = CSharpScript(x=min_cross_circulation_spacing, y=panel_15)  # -> out, b, c, a; inputs x: Int32, y: Int32; disabled
# ---------- min_cross_circulation: C# ----------
// Grasshopper Script Instance
#region Usings
using System;
using System.Linq;
using System.Collections;
using System.Collections.Generic;
using System.Drawing;

using Rhino;
using Rhino.Geometry;

using Grasshopper;
using Grasshopper.Kernel;
using Grasshopper.Kernel.Data;
using Grasshopper.Kernel.Types;
#endregion

public class Script_Instance : GH_ScriptInstance
{
    #region Notes
    /* 
      Members:
        RhinoDoc RhinoDocument
        GH_Document GrasshopperDocument
        IGH_Component Component
        int Iteration

      Methods (Virtual & overridable):
        Print(string text)
        Print(string format, params object[] args)
        Reflect(object obj)
        Reflect(object obj, string method_name)
    */
    #endregion

    private void RunScript(int x, int y, ref object b, ref object c, ref object a)
    {
        if(x>y)
        {a=$"You can reduce {x-y}m for cross circulation per aisle.";
         b=true;
         c=0;}
        else if(x<y)
        {a=$"You need to increase {y-x}m for cross circulation per aisle.";
         b=false;
         c=2;}
        else if(x==y)
        {a=$"Optimum cross circulation aisle";
         b=true;
         c=1;}
    }
}
# ---------- end min_cross_circulation ----------
int_3 = Integer(min_cross_circulation.b)  # disabled

multiplication_16 = Multiplication(A=simplify(graft(range_2)), B=subtraction_8)  # -> simplify(Result)
addition_5 = Addition(A=addition_4, B=multiplication_16)
X_8 = UnitX(Factor=addition_5)

move_5 = Move(Geometry=item_7, Motion=X_8)  # -> Geometry, Transform; disabled
move2pt = MoveToPoint(Geometry=_2checkin_module, PointA=<geometry referenced from the Rhino model>, PointB=move_5.Geometry)  # -> Moved, Vector, Transform; disabled

lng_5 = ListLength(List=flatten(move_5.Geometry))  # disabled
xy_3 = XYPlane(Origin=move_5.Geometry)  # disabled
brec_8 = BoundingRectangle(Geometry=move2pt.Moved, Plane=PlaneXY(0, 0, 0), Axis=0, Slide=0, Union=True)  # -> simplify(Bounding), DimensionX, DimensionY; disabled
insert_3 = InsertBlock(BlockName="Block 01", Plane=xy_3)  # disabled
disc_3 = Discontinuity(Curve=brec_8.Bounding, Level=1)  # -> Points, Parameters; disabled
shatter_3 = Shatter(Curve=brec_8.Bounding, Parameters=disc_3.Parameters)  # disabled
item_11 = ListItem(List=shatter_3, Index=0, Wrap=True)  # -> Item1, Item, Item1_2, Item2; disabled
crv_3 = Curve(item_11.Item2)  # disabled
len_3 = Length(Curve=crv_3)  # disabled
eval_4 = EvaluateCurve(Curve=reparameterize(crv_3), Parameter=panel_65)  # -> Point, Tangent, Angle; disabled
dom_6 = ConstructDomain(DomainStart=expr("-x/2", len_3), DomainEnd=expr("x/2", len_3))  # disabled

move_6 = Move(Geometry=xy_3, Motion=X_3)  # -> Geometry, Transform; disabled
multiplication_17 = Multiplication(A=lng_5, B=panel_9)  # disabled
min_check_in = CSharpScript(x=multiplication_17, y=total_check_in_counters)  # -> out, a; inputs x: Int32, y: Int32; disabled
# ---------- min_check_in: C# ----------
// Grasshopper Script Instance
#region Usings
using System;
using System.Linq;
using System.Collections;
using System.Collections.Generic;
using System.Drawing;

using Rhino;
using Rhino.Geometry;

using Grasshopper;
using Grasshopper.Kernel;
using Grasshopper.Kernel.Data;
using Grasshopper.Kernel.Types;
#endregion

public class Script_Instance : GH_ScriptInstance
{
    #region Notes
    /* 
      Members:
        RhinoDoc RhinoDocument
        GH_Document GrasshopperDocument
        IGH_Component Component
        int Iteration

      Methods (Virtual & overridable):
        Print(string text)
        Print(string format, params object[] args)
        Reflect(object obj)
        Reflect(object obj, string method_name)
    */
    #endregion

    private void RunScript(int x, int y, ref object a)
    {
        if(x>y)
        a=$"You can reduce {x-y} check in counters.";
        else if(x<y)
        a=$"You need to increase {y-x} heck in counters.";
        else if(x==y)
        a=$"The Configuration matches the check in counter demand.";
    }
}
# ---------- end min_check_in ----------
furniture_blocks_3 = StreamFilter(Gate=orientation_of_check_in_counters, Stream0=insert_3, Stream1=[merge_3, merge_2])  # disabled

# ---- group: Counter Blocks
geo_2 = Geometry(flatten(furniture_blocks_3))  # disabled
c_bake_5 = ContextBake(Counters_0_0_0=geo_2)  # disabled

# ----
multiplication_18 = Multiplication(A=multiplication_12, B=area_for_ropes_corners)  # disabled
md_slider_3 = MDSlider(
    SliderMode=0,
    slider_value=Point(0.502658751, 0, 0.5),
    x_domain=Domain(0, 1),
    y_domain=Domain(0, 1),
    z_domain=Domain(0, 1))  # disabled
division_20 = Division(A=multiplication_18, B=division_3)  # disabled
multiplication_19 = Multiplication(A=division_20, B=lng_3)  # -> simplify(Result); disabled
division_21 = Division(A=multiplication_19, B=len_3)  # -> simplify(Result); disabled

division_22 = Division(A=multiplication_18, B=ma_2.Result)  # disabled
multiplication_20 = Multiplication(A=division_22, B="2")
addition_6 = Addition(A=multiplication_9, B=multiplication_20)
subtraction_9 = Subtraction(A=shift, B=addition_6)  # disabled
dom_7 = ConstructDomain(DomainStart=0, DomainEnd=division_22)  # disabled
addition_7 = Addition(A=division_22, B=addition_2, C=division_15)  # disabled

rectangle_3 = Rectangle(Plane=simplify(prot_2), XSize=dom_5, YSize=dom_7, Radius=0)  # -> Rectangle, Length; disabled
rectangle_4 = Rectangle(Plane=simplify(prot), XSize=dom_5, YSize=dom_7, Radius=0)  # -> simplify(Rectangle), Length; disabled
flatten = FlattenTree(Tree=[rectangle_4.Rectangle, rectangle_3.Rectangle], Path="{0}")  # disabled

multiplication_21 = Multiplication(A=addition_7, B=subtraction_5, C=panel_22)  # disabled
roundd = RoundToDecimalPlace(NumberX=multiplication_21, DecimalPlace=panel_20, RoundType=0)  # -> Rounded, Difference; disabled
roundd_2 = RoundToDecimalPlace(NumberX=division_22, DecimalPlace=panel_20, RoundType=2)  # -> Rounded, Difference; disabled
partition_2 = PartitionList(List=flatten, Size=panel_24)  # disabled
brec_9 = BoundingRectangle(Geometry=flatten, Plane=PlaneXY(0, 0, 0), Axis=0, Slide=0, Union=True)  # -> Bounding, DimensionX, DimensionY; disabled
brec_10 = BoundingRectangle(Geometry=partition_2, Plane=PlaneXY(0, 0, 0), Axis=0, Slide=0, Union=False)  # -> Bounding, DimensionX, DimensionY; disabled
multiplication_22 = Multiplication(A=brec_9.DimensionY, B=brec.DimensionX)  # disabled
offset_7 = OffsetCurve(Curve=brec_9.Bounding, Distance=1, Corners=1)  # disabled
rdiff = RegionDifference(CurvesA=brec_9.Bounding, CurvesB=flatten(brec_10.Bounding))  # disabled
subtraction_10 = Subtraction(A=dim.UDimension, B=roundd.Rounded)  # disabled
roundf_2 = RoundToFactor(NumberX=multiplication_22, Factor=panel_27, RoundType=0)  # -> Rounded, Difference, MultiplierR, MultiplierX; disabled
brec_11 = BoundingRectangle(Geometry=rdiff, Plane=PlaneXY(0, 0, 0), Axis=0, Slide=0, Union=False)  # -> Bounding, DimensionX, DimensionY; disabled
division_23 = Division(A=subtraction_10, B=subtraction_5)  # disabled
paramptinrec_2 = ParameterPointInRectangle(Rectangle=brec_11.Bounding, ParameterX=0.5, ParameterY=0)  # -> Point, Normal; disabled
min_circulation_space = CSharpScript(x=division_23, y=panel_28)  # -> out, b, a; inputs x: Int32, y: Double; disabled
# ---------- min_circulation_space: C# ----------
// Grasshopper Script Instance
#region Usings
using System;
using System.Linq;
using System.Collections;
using System.Collections.Generic;
using System.Drawing;

using Rhino;
using Rhino.Geometry;

using Grasshopper;
using Grasshopper.Kernel;
using Grasshopper.Kernel.Data;
using Grasshopper.Kernel.Types;
#endregion

public class Script_Instance : GH_ScriptInstance
{
    #region Notes
    /* 
      Members:
        RhinoDoc RhinoDocument
        GH_Document GrasshopperDocument
        IGH_Component Component
        int Iteration

      Methods (Virtual & overridable):
        Print(string text)
        Print(string format, params object[] args)
        Reflect(object obj)
        Reflect(object obj, string method_name)
    */
    #endregion

    private void RunScript(int x, double y, ref object b, ref object a)
    {
        if(x>y)
       { a=$"You can reduce {x-y}m for cross circulation per aisle.";
         b= true;}
        else if(x<y)
        {a=$"You need to increase {y-x}m for cross circulation per aisle.";
          b= false;}
        else if(x==y)
       { a=$"Optimum cross circulation aisle";
        b= true;}
    }
}
# ---------- end min_circulation_space ----------
dispatch_4 = Dispatch(List=paramptinrec_2.Point, DispatchPattern=[True, False])  # -> ListA, ListB; disabled
int_4 = Integer(min_circulation_space.b)  # disabled
multiplication_23 = Multiplication(A=division_21, B=division_17)  # disabled

addition_8 = Addition(A=panel_66, B=multiplication_23)  # disabled
dom_8 = ConstructDomain(DomainStart=panel_66, DomainEnd=addition_8)  # disabled
rectangle_5 = Rectangle(Plane=eval_4.Point, XSize=dom_6, YSize=dom_8, Radius=0)  # -> Rectangle, Length; disabled

area_3 = Area(Geometry=rectangle_5.Rectangle)  # -> Area, Centroid; disabled
brec_12 = BoundingRectangle(Geometry=flatten(rectangle_5.Rectangle), Plane=PlaneXY(0, 0, 0), Axis=0, Slide=0, Union=True)  # -> Bounding, DimensionX, DimensionY; disabled
ma_4 = MassAddition(Input=flatten(area_3.Area))  # -> Result, PartialResults; disabled
area_4 = Area(Geometry=brec_12.Bounding)  # -> Area, Centroid; disabled
rdiff_2 = RegionDifference(CurvesA=brec_12.Bounding, CurvesB=flatten(rectangle_5.Rectangle))  # disabled
evalsrf_2 = EvaluateSurface(Surface=reparameterize(brec_12.Bounding), Point=md_slider)  # -> Point, Normal, UDirection, VDirection, Frame; disabled
paramptinrec_3 = ParameterPointInRectangle(Rectangle=rdiff_2, ParameterX=1, ParameterY=0.5)  # -> Point, Normal; disabled
addition_9 = Addition(A=brec_12.DimensionY, B=panel_25, C=brec_2.DimensionY)  # disabled
division_24 = Division(A=addition_9, B=brec_12.DimensionY)  # disabled
area_5 = Area(Geometry=rdiff_2)  # -> Area, Centroid; disabled
subtraction_11 = Subtraction(A=multiplication_13, B=area_5.Area)  # disabled
scale_nu_2 = ScaleNU(Geometry=brec_12.Bounding, Plane=evalsrf_2.Point, ScaleX=1, ScaleY=division_24, ScaleZ=1)  # -> Geometry, Transform; disabled
area_6 = Area(Geometry=scale_nu_2.Geometry)  # -> Area, Centroid; disabled
area_7 = Area(Geometry=scale_nu_2.Geometry)  # -> Area, Centroid; disabled
addition_10 = Addition(A=subtraction_11, B=area_6.Area)  # disabled

evalsrf_3 = EvaluateSurface(Surface=reparameterize(scale_nu_2.Geometry), Point=md_slider_3)  # -> Point, Normal, UDirection, VDirection, Frame; disabled
item_12 = ListItem(List=addition_10, Index=0, Wrap=True)  # disabled
division_25 = Division(A=item_12, B=area_6.Area)  # disabled
item_13 = ListItem(List=flatten(multiplication_23), Index=0, Wrap=True)  # disabled

scale_nu_3 = ScaleNU(Geometry=scale_nu_2.Geometry, Plane=evalsrf_3.Point, ScaleX=1, ScaleY=division_25, ScaleZ=1)  # -> Geometry, Transform; disabled
offset_8 = OffsetCurve(Curve=scale_nu_3.Geometry, Distance=1, Corners=1)  # disabled
roundf_3 = RoundToFactor(NumberX=area_7.Area, Factor=panel_23, RoundType=0)  # -> Rounded, Difference, MultiplierR, MultiplierX; disabled
subtraction_12 = Subtraction(A=brec_3.DimensionY, B=addition_9)  # disabled
min_cross_circulation_2 = CSharpScript(x=subtraction_12, y=panel_15)  # -> out, b, a; inputs x: Int32, y: Int32; disabled
# ---------- min_cross_circulation_2: C# ----------
// Grasshopper Script Instance
#region Usings
using System;
using System.Linq;
using System.Collections;
using System.Collections.Generic;
using System.Drawing;

using Rhino;
using Rhino.Geometry;

using Grasshopper;
using Grasshopper.Kernel;
using Grasshopper.Kernel.Data;
using Grasshopper.Kernel.Types;
#endregion

public class Script_Instance : GH_ScriptInstance
{
    #region Notes
    /* 
      Members:
        RhinoDoc RhinoDocument
        GH_Document GrasshopperDocument
        IGH_Component Component
        int Iteration

      Methods (Virtual & overridable):
        Print(string text)
        Print(string format, params object[] args)
        Reflect(object obj)
        Reflect(object obj, string method_name)
    */
    #endregion

    private void RunScript(int x, int y, ref object b, ref object a)
    {
        if(x<y)
        {a=$"You need {y-x}m space for circulation behind queueing area.";
         b=true;}
        else if((x>y)&&((x-y)<10))
        {a=$"You have {x-y}m deep Check-In Hall area,do check if that's sufficient.";
         b=false;}
        else 
        {a=$"You have {x-y}m deep Check-In Hall area,do check if it's not overdesigned.";
         b=true;}
    }
}
# ---------- end min_cross_circulation_2 ----------
panel_69 = Panel(subtraction_12)  # disabled
queue_area = StreamFilter(Gate=orientation_of_check_in_counters, Stream0=rectangle_5.Rectangle, Stream1=flatten)  # disabled
que_depth = StreamFilter(Gate=orientation_of_check_in_counters, Stream0=item_13, Stream1=roundd_2.Rounded)  # disabled
furniture_blocks_4 = StreamFilter(Gate=orientation_of_check_in_counters, Stream0=int_3, Stream1=int_4)  # disabled
furniture_blocks_5 = StreamFilter(Gate=orientation_of_check_in_counters, Stream0=roundf_3.Rounded, Stream1=roundf_2.Rounded)  # disabled
total_cuvre = StreamFilter(Gate=orientation_of_check_in_counters, Stream0=offset_8, Stream1=offset_7)  # disabled
total_cuvre_2 = StreamFilter(Gate=orientation_of_check_in_counters, Stream0=paramptinrec_3.Point, Stream1=dispatch_4.ListB)  # disabled
gate = StreamGate(Stream=furniture_blocks, Gate=furniture_blocks_4)  # -> Target0, Target1; disabled
gate_2 = StreamGate(Stream=rectangle.Rectangle, Gate=furniture_blocks_4)  # -> Target0, Target1; disabled

Y_4 = UnitY(Factor=1)  # disabled
panel_70 = Panel("4")  # disabled
line_5 = LineSDL(Start=total_cuvre_2, Direction=expr("-x", Y_4), Length=panel_70)  # disabled
end = EndPoints(Curve=line_5)  # -> Start, End; disabled
panel_71 = Panel("1.5")  # disabled
panel_72 = Panel("45")  # disabled
Z_3 = UnitZ(Factor=1)  # disabled
X_9 = UnitX(Factor=end.End)  # disabled
panel_73 = Panel("45")  # disabled
vrot = Rotate(Vector=X_9, Axis=Z_3, Angle=degrees(panel_73))  # disabled
yz = YZPlane(Origin=end.End)  # disabled
line_6 = LineSDL(Start=end.End, Direction=vrot, Length=panel_71)  # disabled
mirror_2 = Mirror(Geometry=line_6, Plane=yz)  # -> Geometry, Transform; disabled

check_in_area = Panel(furniture_blocks_5)  # disabled
panel_74 = Panel(roundf_3.Rounded)  # disabled
srf_3 = Surface(gate_2.Target0)  # disabled
preview_2 = CustomPreview(Geometry=srf_3, Material=over_design)  # disabled
concat_10 = Concatenate(FragmentD=panel_35, FragmentA=check_in_area, FragmentB=panel_37, FragmentC=gate.Target0)  # disabled
move_7 = Move(Geometry=end.Start, Motion=Y_3)  # -> Geometry, Transform; disabled
line_7 = LineSDL(Start=move_7.Geometry, Direction=expr("-x", X_6), Length=panel_36)  # disabled
line_8 = LineSDL(Start=move_7.Geometry, Direction=X_6, Length=panel_36)  # disabled
join_2 = JoinCurves(Curves=[line_8, line_7], Preserve=False)  # -> flatten(Curves); disabled
srf_4 = Surface(total_cuvre)  # disabled
flip_4 = FlipCurve(Curve=join_2)  # -> Curve, Flag; disabled
join_3 = JoinCurves(Curves=[mirror_2.Geometry, line_6, line_5], Preserve=False)  # disabled
textsrf_3 = TextOnSurface(Text=concat_2, Font="Sans Bold:no Italic:no", Height=1.2, Depth=0, BaseLine=flip_4.Curve, BaseSurface=srf_4)  # -> flatten(Symbols); disabled
offcrv = OffsetCurve(Curve=join_3, Plane=PlaneXY(0, 0, 0), Distance=-0.2, BothSides=0.2, Kinks=0, CapType=1)  # -> flatten(Offset); disabled
runion = RegionUnion(Curves=offcrv)  # disabled
srf_5 = Surface(queue_area)  # disabled
srf_6 = Surface(runion)  # disabled
runion_2 = RegionUnion(Curves=flatten(srf_5))  # disabled
crv_4 = Curve(runion_2)  # disabled
srf_7 = Surface(crv_4)  # disabled
queue_area_sq_m = Panel(multiplication_18)  # disabled
queue_depth_m = Panel(que_depth)  # disabled
area_8 = Area(Geometry=crv_4)  # -> Area, Centroid; disabled
gltfdisplay = GlTF20Display(Geometry=srf_7, Material=filter_11)  # disabled
c_bake_6 = ContextBake(CheckInArea=srf_7)  # disabled
sort_pt_2 = SortPoints(Points=area_8.Centroid)  # -> Points, Indices; disabled
concat_11 = Concatenate(FragmentA=panel_43, FragmentD=panel_49, FragmentB=queue_depth_m)  # disabled
concat_12 = Concatenate(FragmentA=panel_45, FragmentD=panel_49, FragmentB=queue_area_sq_m)  # disabled
index_2 = ItemIndex(List=sort_pt_2.Points, Item=sort_pt_2.Points)  # disabled
item_14 = ListItem(List=panel_50, Index=index_2, Wrap=True)  # disabled
merge_4 = Merge(Data1=concat_8, Data2=concat_12, Data3=concat_5, Data4=concat_7, Data5=concat_6, Data6=concat_11)  # -> flatten(Result); disabled
c_print_2 = ContextPrint(Metrics=merge_4)
concat_13 = Concatenate(FragmentA=panel_51, FragmentB=item_14)  # disabled
pl_origin = PlaneOrigin(Base=tag_orientation, Origin=sort_pt_2.Points)  # disabled
brec_13 = BoundingRectangle(Geometry=srf_7, Plane=pl_origin, Axis=0, Slide=0, Union=True)  # -> Bounding, flatten(DimensionX), DimensionY; disabled
item_15 = ListItem(List=brec_13.DimensionX, Index=0, Wrap=True)  # disabled
deplane = DeconstructPlane(Plane=pl_origin)  # -> Origin, XAxis, YAxis, ZAxis; disabled
amp = Amplitude(Vector=deplane.XAxis, Amplitude=expr("-x/2", item_15))  # disabled
offset_9 = OffsetCurve(Curve=total_cuvre, Distance=expr("-x/2", panel_56), Corners=1)  # disabled
offset_10 = OffsetCurve(Curve=total_cuvre, Distance=expr("x/2", panel_56), Corners=1)  # disabled
move_8 = Move(Geometry=pl_origin, Motion=amp)  # -> Geometry, Transform; disabled

c_bake_7 = ContextBake(Arrows_0_0_0=srf_6)  # disabled
c_bake_8 = ContextBake(Text_0_0_0=textsrf_3)  # disabled

boundary_2 = BoundarySurfaces(Edges=[offset_9, offset_10])  # disabled
line_9 = LineSDL(Start=move_8.Geometry, Direction=deplane.XAxis, Length=item_15)  # disabled
area_9 = Area(Geometry=offset_9)  # -> Area, Centroid; disabled
roundf_4 = RoundToFactor(NumberX=area_9.Area, Factor=panel_57, RoundType=0)  # -> Rounded, Difference, MultiplierR, MultiplierX; disabled
textsrf_4 = TextOnSurface(Text=concat_13, Font="Sans Bold:no Italic:no", Height=panel_58, Depth=0, BaseLine=line_9, BaseSurface=srf_7)  # disabled
move_9 = Move(Geometry=textsrf_4, Motion=Z_2)  # -> Geometry, Transform; disabled

panel_75 = Panel("1.")  # disabled
panel_76 = Panel("2.")  # disabled
panel_77 = Panel("3.")  # disabled
panel_78 = Panel("4.")  # disabled
concat_14 = Concatenate(FragmentA=panel_77, FragmentB=min_cross_circulation.a)  # disabled
concat_15 = Concatenate(FragmentA=panel_75, FragmentB=min_check_in.a)  # disabled
concat_16 = Concatenate(FragmentA=panel_78, FragmentB=min_cross_circulation_2.a)  # disabled
concat_17 = Concatenate(FragmentA=panel_76, FragmentB=item_10)  # disabled
config_summariser = Concatenate(
    Min_Counters=concat_15,
    C=panel_61,
    Min_Walk=concat_17,
    A=panel_61,
    Min_Cross_Space=concat_14,
    B=panel_61,
    Min_Space_Behind_Queue=concat_16)  # disabled

concat_18 = Concatenate(FragmentA=panel_60, FragmentB=roundf_4.Rounded, FragmentC=panel_59)  # disabled

concat_19 = Concatenate(FragmentA=panel_75, FragmentB=min_counters.a, FragmentC=panel_62)  # disabled
concat_20 = Concatenate(FragmentA=panel_76, FragmentB=min_circulation_space.a)  # disabled
concat_21 = Concatenate(FragmentA=panel_77, FragmentB=min_circulation_space.a)  # disabled
config_summariser_2 = Concatenate(Min_Counters=concat_19, A=panel_61, Min_Cross_Space=concat_20, B=panel_61)  # disabled

tag = TextTag3D(Location=furniture_blocks_2, Text=concat_10, Size=2, Colour=swatch, Justification=7)  # disabled
iata_los_summary = Concatenate(LoS_Provided=concat_9, A=panel_61, Min_Cross_Space=concat_18, B=panel_61)  # disabled
c_print_3 = ContextPrint(LoSSummary=iata_los_summary)  # disabled
filter_12 = StreamFilter(Gate=orientation_of_check_in_counters, Stream0=config_summariser, Stream1=config_summariser_2)  # disabled
txt = Text(flatten(filter_12))  # disabled

# ----
# Summary:
# Metrics:
panel_79 = Panel(merge_4)
# Suggested Improvements:
panel_80 = Panel(txt)
panel_81 = Panel(iata_los_summary)

c_print_4 = ContextPrint(SuggestedLayoutImprovements=txt)

# ---- group: Check In Area
c_bake_9 = ContextBake(CheckIn_BoundingBox_179_57_26=flatten(boundary_2))  # disabled

# ---- group: Check In Zone Texts
c_bake_10 = ContextBake(Zone_225_231_254=flatten(move_9.Geometry))  # disabled
